# Grasshopper definition VisualizeDataExample_.gh (Grasshopper 1.0.8)
# plug-ins: VisuAlFroG

path = FilePath("..\example\ExampleData.csv")
file = ReadFile(File=path, PerLineParse=True)
panel = Panel(""",
 """)
split = TextSplit(Text=file, Separators=panel)
domain = Domain(Domain(3, 29))
path_2 = FilePath("T:\02-Management\09_Datamanagement\RSE\VisuAlFrog\repository\VisuAlFroG\WPFApplication\bin\x64\Debug\visualfrog_configuration_2.json")
subset = SubList(List=split, Domain=domain, Wrap=True)  # -> List, Index
panel_2 = Panel(subset.List)
visfrog = VISualizationFRameworkFOrGrasshopper(GenericInputData=subset.List, ConfigurationFilePath=path_2)
panel_3 = Panel(visfrog)
