# Grasshopper definition example.gh (Grasshopper 1.0.8)
# plug-ins: VisuAlFroG

input_data_path = Panel("C:\Users\Markus\Documents\Git\GitHubEnterprise\VisuAlFroG\example\example-data_2.csv")
input_data_path_2 = Panel("C:\Users\marku\Documents\Git\GitHubEnterprise\VisuAlFroG\example\example-data.csv")
input_data_path_3 = Panel("C:\Users\Markus\Documents\Git\GitHubEnterprise\VisuAlFroG\example\example-data.csv")
json_file_path = Panel("C:\Users\Markus\Documents\Git\GitHubEnterprise\VisuAlFroG\example\samples\NSGAII-Front_DF_Q_tot_00.json")
path = FilePath(input_data_path)
path_2 = FilePath(json_file_path)
separator = Panel(";")
separator_2 = Panel(";")
file = ReadFile(File=path_2, PerLineParse=True)
file_2 = ReadFile(File=path, PerLineParse=True)
split = TextSplit(Text=file, Separators=separator)
split_2 = TextSplit(Text=file_2, Separators=separator_2)
panel = Panel(split)
panel_2 = Panel(split_2)
panel_3 = Panel(file_2)
command_line_arguments = Panel("--config C:\Users\marku\Documents\Git\GitHubEnterprise\VisuAlFroG\example\visualfrog_configuration.json")
sample_path = Panel("C:\Users\Markus\Documents\Git\GitHubEnterprise\VisuAlFroG\example\samples")
visualfrog = VisualAnalyticsFrameworkForGrasshopper(GenericInputData=split_2, CommandLineArguments=command_line_arguments, InputSampleFilesPath=sample_path)
output = Panel(visualfrog)
