# Grasshopper definition linking.gh (Grasshopper 1.0.8)
# plug-ins: VisuAlFroG

panel = Panel("\"C:\\Users\\Markus\\Documents\\Git\\GitHubEnterprise\\VisuAlFroG\\example\\MOEAD_01.json\"")
gene_pool = GenePool(Decimals=2, Maximum=100, Minimum=0, Value=[50, 57.63, 23.86, 50, 50, 50, 50, 50, 50, 50])
number_slider = Slider(0.554, range=0..1)
number_slider_2 = Slider(0.394, range=0..1)
file_path = FilePath(panel)
eval = Evaluate(E="(x*y)-z*2+x", x=number_slider, y=number_slider_2, z=Slider(0.46, range=0..1))
num = Number(eval)
python_3_script = Python3Script(x=number_slider, y=number_slider_2)  # -> out, a; inputs x: Double, y: Double
# ---------- python_3_script: Python ----------
a = x + y
# ---------- end python_3_script ----------
panel_2 = Panel(num)
visualfrog = VisualAnalyticsFrameworkForGrasshopper()
panel_3 = Panel(visualfrog)
